# Grasshopper definition tree_generation.gh (Grasshopper 1.0.7)

random = Random(Range=Domain(0, 1), Number=1, Seed=2)
multiplication = Multiplication(A=random, B=Slider(250, range=0..1000))
# segments: # of trunk faces (even number)
# v_multiplier : only for texture mapping
# length_falloff_factor: branch lengths
# length_falloff_power: branch lengths
# branch_factor: close to spread out branches
int = Integer(multiplication)
panel = Panel(int)
# levels: branching levels
panel_2 = Panel("5.5")
# max_clumping
panel_3 = Panel(".515")
# min_clumping
panel_4 = Panel("0.514")
# drop_amount: gravity (non initial branches)
panel_5 = Panel("0.015")
# grow_amount start: gravity (first_step)
panel_6 = Panel("-0.010")
# max_radius: trunk/branch thickness
panel_7 = Panel("0.05")
# climb rate: branching height
panel_8 = Panel("0.04")
# tree_steps: Number of branches
panel_9 = Panel("30")
# taper rate
panel_10 = Panel("1.001")
# radius_falloff_rate: trunk to branch radius ratio?
panel_11 = Panel(".55")
# twist_rate
panel_12 = Panel("2.6")
# trunk_kink
panel_13 = Panel("0.005")
# branch_length_scale_start (first_step)
panel_14 = Panel("1.0")
# branch_length_scale_end (last_step)
panel_15 = Panel("1.0")
# twig_scale: leaf density
panel_16 = Panel("0.60")
# initial_branch_length
panel_17 = Panel("0.45")
# grow_amount end: gravity (last_step)
panel_18 = Panel("0.008")
# trunk_length
panel_19 = Panel("1.1")
# sweep_amount: wind
panel_20 = Panel("0")
# scale factor
panel_21 = Panel("1.0")
proctree_js_to_gh_python = GhPythonScript(
    seed=panel,
    segments="4",
    levels=panel_2,
    v_multiplier="2.36",
    twig_scale=panel_16,
    initial_branch_length=panel_17,
    length_falloff_factor=".95",
    length_falloff_power="1.04",
    branch_factor="2.8",
    max_clumping=panel_3,
    min_clumping=panel_4,
    drop_amount=panel_5,
    grow_amount_start=panel_6,
    grow_amount_end=panel_18,
    max_radius=panel_7,
    climb_rate=panel_8,
    tree_steps=panel_9,
    taper_rate=panel_10,
    radius_falloff_rate=panel_11,
    trunk_length=panel_19,
    twist_rate=panel_12,
    sweep_amount=panel_20,
    trunk_kink=panel_13,
    branch_length_scale_start=panel_14,
    branch_length_scale_end=panel_15,
    scale_by=panel_21)  # -> out, geom_trunk, geom_leaves, len_branches; inputs seed: Int32, segments: Int32, levels: Int32, tree_steps: Int32
# ---------- proctree_js_to_gh_python: Python ----------
"""A port of proctree.js to Python using the Rhinoscript Python geometry libraries."""

__author__ = "ajakubiec"
__version__ = "2021.07.06"

import math, random
import rhinoscriptsyntax as rs

# set random seed
if seed:
    random.seed(seed)

len_branches = 0.0

# define functions for use outside of rhinoscriptsyntax ----
def dot(v1, v2):
    return v1[0]*v2[0]+v1[1]*v2[1]+v1[2]*v2[2]

def cross(v1, v2):
    return [v1[1]*v2[2]-v1[2]*v2[1],v1[2]*v2[0]-v1[0]*v2[2],v1[0]*v2[1]-v1[1]*v2[0]]

def get_length(v):
    return math.sqrt(v[0]*v[0]+v[1]*v[1]+v[2]*v[2])

def unitize(v):
    l = get_length(v)
    return vector_scale(v, 1.0 / l)

def vector_scale(v, s):
    return [v[0]*s,v[1]*s,v[2]*s]

def vector_subtract(v1, v2):
    return [v1[0]-v2[0],v1[1]-v2[1],v1[2]-v2[2]]

def vector_add(v1, v2):
    return [v1[0]+v2[0],v1[1]+v2[1],v1[2]+v2[2]]

def vector_axis_angle(vec, axis, angle):
    cosr = math.cos(angle);
    sinr = math.sin(angle);
    return vector_add(vector_add(vector_scale(vec,cosr),vector_scale(cross(axis,vec),sinr)),vector_scale(axis,dot(axis,vec)*(1-cosr)))

def scale_in_direction(vector, direction, scale):
    currentMag = dot(vector,direction);
    change = vector_scale(direction,currentMag*scale-currentMag);
    return vector_add(vector,change)


class Tree:
    def __init__(self):
        # initial things // 
        # proctree.js properties are set in the global GH script through the GH canvas
        self.root = Branch(head = [0.0, trunk_length, 0.0]) # vector purely in y-positive direction
        self.root.length = initial_branch_length
        self.verts = []
        self.faces = []
        self.normals = []
        self.uv = []
        self.verts_twig = []
        self.normals_twig = []
        self.faces_twig = []
        self.uvs_twig = []
        
        # call split
        self.root.split(levels, tree_steps)
        
        # create forks
        self.create_forks()
        
        # create twigs
        self.create_twigs()
        
        # do faces
        self.do_faces()
        
        # calc_normals
        self.calc_normals()
        
    def create_forks(self, branch = False, radius = False):
        if not branch:
            branch = self.root
        if not radius:
            radius = max_radius
        
        branch.radius = radius
        
        if radius > branch.length:
            radius = branch.length
        
        segment_angle = math.pi * 2.0 / float(segments)
        
        if not branch.parent:
            branch.root = []
            axis = [0.0, 1.0, 0.0]
            
            for i in range(segments):
                vec = vector_axis_angle([-1.0, 0.0, 0.0], axis, -1.0 * segment_angle * float(i))
                branch.root.append(len(self.verts))
                self.verts.append(vector_scale( vec, radius / radius_falloff_rate))
        
        if branch.child0:
            if branch.parent:
                axis = unitize(vector_subtract(branch.head, branch.parent.head))
            else:
                axis = unitize(branch.head)
            
            axis1 = unitize(vector_subtract(branch.head, branch.child0.head))
            axis2 = unitize(vector_subtract(branch.head, branch.child1.head))
            tangent = unitize(cross(axis1, axis2))
            branch.tangent = tangent
            
            axis3 = unitize(cross(tangent, unitize(vector_add(vector_scale(axis1, -1.0), vector_scale(axis2, -1.0)))))
            dir = [axis2[0], 0.0, axis2[2]]
            centerloc = vector_add(branch.head, vector_scale(dir, -1.0 * max_radius / 2.0))
            
            branch.ring0 = []
            branch.ring1 = []
            branch.ring2 = []
            
            scale = radius_falloff_rate
            
            if branch.child0.type == "trunk" or branch.type == "trunk":
                scale = 1.0 / taper_rate
            
            linch0 = len(self.verts)
            
            branch.ring0.append(linch0)
            branch.ring2.append(linch0)
            
            self.verts.append( vector_add(centerloc, vector_scale(tangent, radius * scale)) )
            
            start = len(self.verts) - 1
            d1 = vector_axis_angle(tangent, axis2, 1.57)
            d2 = unitize(cross(tangent, axis))
            s = 1.0 / dot(d1, d2)
            for i in range(1, int(segments / 2), 1):
                vec = vector_axis_angle(tangent, axis2, segment_angle * float(i))
                branch.ring0.append(start + i)
                branch.ring2.append(start + i)
                vec = scale_in_direction(vec, d2, s)
                self.verts.append(vector_add(centerloc, vector_scale(vec, radius * scale)))
            
            linch1 = len(self.verts)
            branch.ring0.append(linch1)
            branch.ring1.append(linch1)
            self.verts.append(vector_add(centerloc, vector_scale(tangent, -1.0 * radius * scale)))
            for i in range(int(segments/2 + 1), segments, 1):
                vec = vector_axis_angle(tangent, axis1, segment_angle * float(i))
                branch.ring0.append(len(self.verts))
                branch.ring1.append(len(self.verts))
                self.verts.append(vector_add(centerloc, vector_scale(vec, radius * scale)))
            
            branch.ring1.append(linch0)
            branch.ring2.append(linch1)
            start = len(self.verts) - 1
            for i in range(1, int(segments / 2), 1):
                vec = vector_axis_angle(tangent, axis3, segment_angle * float(i))
                branch.ring1.append(start + i)
                branch.ring2.append(start + int(segments / 2 - i))
                v = vector_scale(vec, radius * scale)
                self.verts.append(vector_add(centerloc, v))
            
            length0 = get_length(vector_subtract(branch.head, branch.child0.head))
            length1 = get_length(vector_subtract(branch.head, branch.child1.head))
            
            radius0 = radius * radius_falloff_rate
            radius1 = radius0
            
            if branch.child0.type == "trunk":
                radius0 = radius * taper_rate
            
            self.create_forks(branch.child0, radius0)
            self.create_forks(branch.child1, radius1)
            
        else:
            branch.end = len(self.verts)
            self.verts.append(branch.head)
    
    def create_twigs(self, branch = False):
        if not branch:
            branch = self.root
        
        if not branch.child0:
            tangent = unitize(cross(vector_subtract(branch.parent.child0.head, branch.parent.head), vector_subtract(branch.parent.child1.head, branch.parent.head)))
            
            binormal = unitize(vector_subtract(branch.head, branch.parent.head))
            
            normal = cross(tangent, binormal)
            
            vert1 = len(self.verts_twig)
            self.verts_twig.append(vector_add(vector_add(branch.head, vector_scale(tangent, twig_scale)), vector_scale(binormal, twig_scale * 2.0 - branch.length)))
            
            vert2 = len(self.verts_twig)
            self.verts_twig.append(vector_add(vector_add(branch.head, vector_scale(tangent, -1.0 * twig_scale)), vector_scale(binormal, twig_scale * 2.0 - branch.length)))
            
            vert3 = len(self.verts_twig)
            self.verts_twig.append(vector_add(vector_add(branch.head, vector_scale(tangent, -1.0 * twig_scale)), vector_scale(binormal, -1.0 * branch.length)))
            
            vert4 = len(self.verts_twig)
            self.verts_twig.append(vector_add(vector_add(branch.head, vector_scale(tangent, twig_scale)), vector_scale(binormal, -1.0 * branch.length)))
            
            
            
            vert8 = len(self.verts_twig)
            self.verts_twig.append(vector_add(vector_add(branch.head, vector_scale(tangent, twig_scale)), vector_scale(binormal, twig_scale * 2.0 - branch.length)))
            
            vert7 = len(self.verts_twig)
            self.verts_twig.append(vector_add(vector_add(branch.head, vector_scale(tangent, -1.0 * twig_scale)), vector_scale(binormal, twig_scale * 2.0 - branch.length)))
            
            vert6 = len(self.verts_twig)
            self.verts_twig.append(vector_add(vector_add(branch.head, vector_scale(tangent, -1.0 * twig_scale)), vector_scale(binormal, -1.0 * branch.length)))
            
            vert5 = len(self.verts_twig)
            self.verts_twig.append(vector_add(vector_add(branch.head, vector_scale(tangent, twig_scale)), vector_scale(binormal, -1.0 * branch.length)))
            
            self.faces_twig.append([vert1, vert2, vert3])
            self.faces_twig.append([vert4, vert1, vert3])
            
            self.faces_twig.append([vert6, vert7, vert8])
            self.faces_twig.append([vert6, vert8, vert5])
            
            normal = unitize(cross(vector_subtract(self.verts_twig[vert1], self.verts_twig[vert3]), vector_subtract(self.verts_twig[vert2], self.verts_twig[vert3])))
            normal2 = unitize(cross(vector_subtract(self.verts_twig[vert7], self.verts_twig[vert6]), vector_subtract(self.verts_twig[vert8], self.verts_twig[vert6])))
            
            self.normals_twig.append(normal)
            self.normals_twig.append(normal)
            self.normals_twig.append(normal)
            self.normals_twig.append(normal)
            
            self.normals_twig.append(normal2)
            self.normals_twig.append(normal2)
            self.normals_twig.append(normal2)
            self.normals_twig.append(normal2)
            
            self.uvs_twig.append([0,1])
            self.uvs_twig.append([1,1])
            self.uvs_twig.append([1,0])
            self.uvs_twig.append([0,0])
            
            self.uvs_twig.append([0,1])
            self.uvs_twig.append([1,1])
            self.uvs_twig.append([1,0])
            self.uvs_twig.append([0,0])
            
        else:
            self.create_twigs(branch.child0)
            self.create_twigs(branch.child1)
    
    def do_faces(self, branch = False):
        if not branch:
            branch = self.root
            
        if not branch.parent:
            for i in range(len(self.verts)):
                self.uv.append([0.0,0.0])
            
            tangent = unitize(cross(vector_subtract(branch.child0.head, branch.head), vector_subtract(branch.child1.head, branch.head)))
            
            normal = unitize(branch.head)
            
            angle = math.acos(dot(tangent, [-1.0, 0.0, 0.0]))
            
            if dot(cross([-1.0, 0.0, 0.0], tangent), normal) > 0.0:
                angle = 2.0 * math.pi - angle
            
            seg_offset = int( round(angle / math.pi / 2.0 * segments) )
            
            for i in range(segments):
                    v1 = branch.ring0[i]
                    v2 = branch.root[(i + seg_offset + 1) % segments]
                    v3 = branch.root[(i + seg_offset) % segments]
                    v4 = branch.ring0[(i+1) % segments]
                    
                    self.faces.append([v1, v4, v3])
                    self.faces.append([v4, v2, v3])
                    
                    self.uv[(i+seg_offset) % segments] = [abs(float(i) / float(segments) - 0.5) * 2.0, 0.0]
                    
                    length = get_length(vector_subtract(self.verts[branch.ring0[i]], self.verts[branch.root[(i+seg_offset) % segments]])) * v_multiplier
                    
                    self.uv[branch.ring0[i]] = [abs(float(i)/float(segments) - 0.5) * 2.0, length]
                    self.uv[branch.ring2[i]] = [abs(float(i)/float(segments) - 0.5) * 2.0, length]
            
        if branch.child0.ring0:
            v1 = unitize(vector_subtract(self.verts[branch.ring1[0]], branch.head))
            v2 = unitize(vector_subtract(self.verts[branch.ring2[0]], branch.head))
            
            v1 = scale_in_direction(v1, unitize(vector_subtract(branch.child0.head, branch.head)), 0.0)
            v2 = scale_in_direction(v1, unitize(vector_subtract(branch.child1.head, branch.head)), 0.0)
            
            for i in range(segments):
                d = unitize(vector_subtract(self.verts[branch.child0.ring0[i]], branch.child0.head))
                l = dot(d, v1)
                try:
                    seg_offset0
                except:
                    seg_offset0 = segments - i
                    match0 = l
                if l > match0:
                    seg_offset0 = segments - i
                    match0 = l
                
                d = unitize(vector_subtract(self.verts[branch.child1.ring0[i]], branch.child1.head))
                l = dot(d, v2)
                try:
                    seg_offset1
                except:
                    seg_offset1 = segments - i
                    match1 = l
                if l > match1:
                    seg_offset1 = segments - i
                    match1 = l
                
            uv_scale = max_radius / branch.radius
            
            for i in range(segments):
                v1 = branch.child0.ring0[i]
                v2 = branch.ring1[(i + seg_offset0 + 1) % segments]
                v3 = branch.ring1[(i + seg_offset0) % segments]
                v4 = branch.child0.ring0[(i + 1) % segments]
                
                self.faces.append([v1, v4, v3])
                self.faces.append([v4, v2, v3])
                
                
                v1 = branch.child1.ring0[i]
                v2 = branch.ring2[(i + seg_offset0 + 1) % segments]
                v3 = branch.ring2[(i + seg_offset0) % segments]
                v4 = branch.child1.ring0[(i + 1) % segments]
                
                self.faces.append([v1, v2, v3])
                self.faces.append([v1, v4, v2])
                
                len1 = get_length(vector_subtract(self.verts[branch.child0.ring0[i]], self.verts[branch.ring1[(i + seg_offset0) % segments]])) * uv_scale
                uv1 = self.uv[branch.ring1[(i + seg_offset0 - 1) % segments]]
                
                self.uv[branch.child0.ring0[i]] = [uv1[0], uv1[1] + len1 * v_multiplier]
                self.uv[branch.child0.ring2[i]] = [uv1[0], uv1[1] + len1 * v_multiplier]
                
                len2 = get_length(vector_subtract(self.verts[branch.child1.ring0[i]], self.verts[branch.ring2[(i + seg_offset1) % segments]])) * uv_scale
                uv2 = self.uv[branch.ring2[(i + seg_offset1 - 1) % segments]]
                
                self.uv[branch.child1.ring0[i]] = [uv2[0], uv2[1] + len2 * v_multiplier]
                self.uv[branch.child1.ring2[i]] = [uv2[0], uv2[1] + len2 * v_multiplier]
            
            self.do_faces(branch.child0)
            self.do_faces(branch.child1)
            
        else:
            for i in range(segments):
                self.faces.append([branch.child0.end, branch.ring1[(i + 1) % segments], branch.ring1[i]])
                self.faces.append([branch.child1.end, branch.ring2[(i + 1) % segments], branch.ring2[i]])
                
                length = get_length(vector_subtract(self.verts[branch.child0.end], self.verts[branch.ring1[i]]))
                self.uv[branch.child0.end] = [abs(float(i) / float(segments) - 1.0 - 0.5) * 2.0, length * v_multiplier]
                
                length = get_length(vector_subtract(self.verts[branch.child1.end], self.verts[branch.ring2[i]]))
                self.uv[branch.child1.end] = [abs(float(i) / float(segments) - 0.5) * 2.0, length * v_multiplier]
                
    def calc_normals(self):
        all_normals = []
        
        for i in range(len(self.verts)):
            all_normals.append([])
        
        for i in range(len(self.faces)):
            face = self.faces[i]
            norm = unitize(cross(vector_subtract(self.verts[face[1]], self.verts[face[2]]), vector_subtract(self.verts[face[1]], self.verts[face[0]])))
            
            all_normals[face[0]].append(norm)
            all_normals[face[1]].append(norm)
            all_normals[face[2]].append(norm)
        
        for i in range(len(all_normals)):
            total = [0.0, 0.0, 0.0]
            
            l = len(all_normals[i])
            
            for j in range(l):
                total = vector_add(total, vector_scale(all_normals[i][j], 1.0 / float(l)))
            
            self.normals.append(total)
    
    def flatten_array(self, input):
        output = []
        
        for i in range(len(input)):
            for j in range(len(input[i])):
                output.append(input[i][j])
        
        return output

class Branch:
    """Proctree.js branch class copy into Python."""
    def __init__(self, head = False, parent = False):
        self.root_ring = False
        self.ring0 = False
        self.ring1 = False
        self.ring2 = False
        self.child0 = False # child branch 1
        self.child1 = False # child branch 2!
        self.length = 1.0
        self.type = False # a type that can be assigned...
        self.radius = 0.0
        if not head:
            self.head = [0.0, 0.0, 0.0]
        else:
            self.head = head
        self.tangent = [0.0, 0.0, 0.0]
        self.parent = parent # can hold another branch instance
        self.end = 0
        self.root = False
    
    def mirror_branch(self, vec, norm):
        v = cross(norm, cross(vec, norm))
        s = branch_factor * dot(v, vec)
        
        return( [vec[0] - v[0] * s, vec[1] - v[1] * s, vec[2] - v[2] * s] )
    
    def split(self, level, steps, l1 = 1, l2 = 1):
        global len_branches
        
        # define this in Tree init statement rather than checking here.. could lead to infinite recursion errors when level == 0 or steps == 0
        # if not level:
        #     level = levels
        # if not steps:
        #     steps = tree_steps
        
        r_level = levels - level
        
        if self.parent:
            po = self.parent.head
        else:
            po = [0.0, 0.0, 0.0]
            self.type = "trunk"
        
        so = self.head
        
        dir = unitize( vector_subtract(so, po) ) 
        
        normal = cross(dir, [dir[2], dir[0], dir[1]])
        
        tangent = cross(dir, normal)
        
        tmp = r_level * 10.0 + l1 * 5.0 + l2 + seed
        r = abs(math.cos(tmp+tmp*tmp)) 
        # r2 = random.random()
        
        adj = vector_add( vector_scale(normal, r), vector_scale(tangent, 1.0 - r))
        
        if r > 0.5:
            adj = vector_scale(adj, -1.0)
        
        clump = (max_clumping - min_clumping) * r + min_clumping
        
        newdir = unitize( vector_add( vector_scale(adj, 1.0 - clump), vector_scale(dir, clump)))
        
        newdir2 = self.mirror_branch(newdir, dir)
        
        if r > 0.5:
            tmp = newdir
            newdir = newdir2
            newdir2 = tmp
        
        if steps > 0:
            angle = float(steps) / float(tree_steps) * 2.0 * math.pi * twist_rate
            newdir2 = unitize( [math.sin(angle), r, math.cos(angle)] )
        
        s_b = (tree_steps - steps) / tree_steps
        s_a = 1.0 - s_b
        
        grow_amount = grow_amount_start * s_a + grow_amount_end * s_b
        
        length_scale = (branch_length_scale_start * s_a + branch_length_scale_end * s_b)
        
        if level == levels:
            self.length = self.length * length_scale
        
        r_grow_amount = float(level) * float(level) / float(levels) * float(levels) * grow_amount
        
        r_drop_amount = r_level * drop_amount
        
        r_sweep_amount = r_level * sweep_amount
        
        newdir = unitize( vector_add(newdir, [r_sweep_amount, r_drop_amount + r_grow_amount, 0.0]))
        
        newdir2 = unitize( vector_add(newdir2, [r_sweep_amount, r_drop_amount + r_grow_amount, 0.0]))
        
        head0 = vector_add(so, vector_scale(newdir, self.length))
        
        head1 = vector_add(so, vector_scale(newdir2, self.length))
        
        self.child0 = Branch(head0, self)
        
        self.child1 = Branch(head1, self)
        
        self.child0.length = math.pow(self.length, length_falloff_power) * length_falloff_factor 
        
        self.child1.length = math.pow(self.length, length_falloff_power) * length_falloff_factor
        
        if level > 0:
            if steps > 0:
                self.child0.head = vector_add(self.head, [(r - 0.5) * 2.0 * trunk_kink, climb_rate, (r - 0.5) * 2.0 * trunk_kink])
                self.child0.type = "trunk"
                self.child0.length = self.length * taper_rate
                
                len_branches += self.child0.length
                
                self.child0.split(level, steps - 1, l1 + 1, l2)
            else:
                len_branches += self.child0.length
                
                self.child0.split(level - 1, 0, l1 + 1, l2)
            len_branches += self.child1.length
            self.child1.split(level - 1, 0, l1, l2 + 1)




this_tree = Tree()

pts = this_tree.verts
faces = this_tree.faces

#pts = []
#for i in range(0, len(tmp_pts), 3):
#    pts.append([tmp_pts[i], tmp_pts[i+1], tmp_pts[i+2]])
#    
#faces = []
#for i in range(0, len(tmp_faces), 3):
#    faces.append([tmp_faces[i], tmp_faces[i+1], tmp_faces[i+2]])

transform1 = rs.XformRotation2(90.0, [1.0, 0.0, 0.0], [0.0, 0.0, 0.0])
transform2 = rs.XformScale(scale_by, point = [0.0, 0.0, 0.0])

transform = rs.XformMultiply(transform1, transform2)

geom_trunk = rs.TransformObject(rs.AddMesh(pts, faces), transform)

pts = this_tree.verts_twig
faces = this_tree.faces_twig

#pts = []
#for i in range(0, len(tmp_pts), 3):
#    pts.append([tmp_pts[i], tmp_pts[i+1], tmp_pts[i+2]])
#    
#faces = []
#for i in range(0, len(tmp_faces), 3):
#    faces.append([tmp_faces[i], tmp_faces[i+1], tmp_faces[i+2]])

geom_leaves = rs.TransformObject(rs.AddMesh(pts, faces), transform)

len_branches = len_branches * scale_by
# ---------- end proctree_js_to_gh_python ----------

# ---- group: Display proctree.js "Twigs"
preview = CustomPreview(Geometry=proctree_js_to_gh_python.geom_leaves, Material=ColourSwatch(SwatchColor=RGBA(126, 209, 31, 20)))

# ---- group: BBox Distance Calculations
bbox = BoundingBox(Content=proctree_js_to_gh_python.geom_trunk, Plane=PlaneXY(0, 0, 0))  # -> Box, Box_2
number_slider = Slider(1, range=0..1)
number_slider_2 = Slider(0, range=0..100)
box = EvaluateBox(Box=bbox.Box, UParameter=number_slider_2, VParameter=number_slider_2, WParameter=number_slider_2)  # -> Plane, Point, Include
box_2 = EvaluateBox(Box=bbox.Box, UParameter=number_slider_2, VParameter=number_slider_2, WParameter=number_slider)  # -> Plane, Point, Include
box_3 = EvaluateBox(Box=bbox.Box, UParameter=number_slider, VParameter=number_slider_2, WParameter=number_slider_2)  # -> Plane, Point, Include
box_4 = EvaluateBox(Box=bbox.Box, UParameter=number_slider_2, VParameter=number_slider, WParameter=number_slider_2)  # -> Plane, Point, Include
dist = Distance(PointA=box.Point, PointB=box_3.Point)
dist_2 = Distance(PointA=box.Point, PointB=box_4.Point)
dist_3 = Distance(PointA=box.Point, PointB=box_2.Point)
max = Maximum(A=dist, B=dist_2)

# ----
folder_location_of_lib_py = Panel("C:\Path\To\lib.py")
estimate_area = GhPythonScript(
    len_branches=proctree_js_to_gh_python.len_branches,
    initial_length=panel_17,
    tree_steps=panel_9,
    levels=panel_2,
    ffactor=".95",
    fpower="1.04",
    thickness=panel_7,
    tfoff=panel_11,
    climb_rate=panel_8,
    scale_by=panel_21)  # -> out, a_proj_est; inputs levels: Int32
# ---------- estimate_area: Python ----------
__author__ = "ajakubiec"
__version__ = "2021.07.19"

initial_length *= scale_by
thickness *= scale_by

import rhinoscriptsyntax as rs

# heuristic - length
len_per_branch = len_branches / float(tree_steps)

# calculated length per branch
lengths = []
radii = []
for i in range(levels - 1):
    if i == 0:
        lengths.append(initial_length)
    else:
        lengths.append( (lengths[-1] ** fpower) * ffactor)
for i in range(levels):
    if i == 0:
        radii.append(thickness * 2.0)
    if i == 1:
        radii.append(radii[-1] * tfoff ** 2.0)
    else:
        radii.append(radii[-1] * tfoff)

sum_length_branching = 0.0
for i in range(levels - 1):
    sum_length_branching += float(i + 1)**2.0 * lengths[i] 

est_area = 0.0
for i in range(levels - 1):
    est_area += float(i + 1)**2.0 * lengths[i] * ((radii[i] + radii[i+1]) / 2.0)

center_area = climb_rate * thickness * 2.0 * (float(tree_steps) - 1.0)

overlap_estimated_reduction = 0.9

a_proj_est = (est_area + center_area) * overlap_estimated_reduction
# ---------- end estimate_area ----------
n_vertices = Panel("20000")
gap_fraction = Panel("0.185")
leaf_cluster_density = Panel("6.5")
trunk_height = Panel(panel_19)
import_canopy = GhPythonScript(
    name="TreeName",
    gap_fraction=gap_fraction,
    height_trunk=trunk_height,
    total_height=dist_3,
    branch_width=max,
    n_vertices=n_vertices,
    estimated_branch_area=estimate_area.a_proj_est,
    scale_by=panel_21,
    cluster_density=leaf_cluster_density,
    code_folder=folder_location_of_lib_py,
    run=Button())  # -> out, canopy_mesh; inputs n_vertices: Int32
# ---------- import_canopy: Python ----------
__author__ = "ajakubiec"
__version__ = "2021.07.18"

import rhinoscriptsyntax as rs
import os, subprocess

height_trunk *= scale_by

height = total_height - height_trunk

if run:
    os.chdir(code_folder)
    
    with open('%s.py' % name, 'w') as f:
        f.write('import lib\n')
        
        if height > (branch_width * 3.0):
            # get_cone
            f.write('lib.get_cone(file_name=\"%s\", ' % name)
            f.write('vertices_count=%i, ' % n_vertices)
            f.write('gap_percentage=%.3f, ' % gap_fraction)
            f.write('height=%.1f, ' % (1.05 * height))
            f.write('radius=%.1f, ' % (1.05 * branch_width / 2.0))
            f.write('branch_area=%.4f,' % estimated_branch_area)
            f.write('cluster_density=%.3f)' % cluster_density)
        elif height > (branch_width / 2.0):
            # gen_ellipsoid_prolate
            f.write('lib.gen_ellipsoid_prolate(file_name=\"%s\", ' % name)
            f.write('vertices_count=%i, ' % n_vertices)
            f.write('gap_percentage=%.3f, ' % gap_fraction)
            f.write('height=%.1f, ' % (1.05 * height))
            f.write('radius=%.1f, ' % (1.05 * branch_width / 2.0))
            f.write('branch_area=%.4f,' % estimated_branch_area)
            f.write('cluster_density=%.3f)' % cluster_density)
        elif height < (branch_width / 2.0):
            # gen_ellipsoid_oblate
            f.write('lib.gen_ellipsoid_oblate(file_name=\"%s\", ' % name)
            f.write('vertices_count=%i, ' % n_vertices)
            f.write('gap_percentage=%.3f, ' % gap_fraction)
            f.write('height=%.1f, ' % (1.05 * height))
            f.write('radius=%.1f, ' % (1.05 * branch_width / 2.0))
            f.write('branch_area=%.4f,' % estimated_branch_area)
            f.write('cluster_density=%.3f)' % cluster_density)
    
    proc = subprocess.Popen(['python', '%s.py' % name], shell=True)
    proc.wait()

path = code_folder + 'output\\%s.obj' % name

import Rhino.Geometry as rg


with open(path, 'r') as file:
    lines = file.readlines()
    
mesh = rg.Mesh()
for line in lines:
    if line.find("v")==0 and line.find("n")==-1 and line.find("t")==-1:
        #print line.split(' ')
        mesh.Vertices.Add(rg.Point3d(float((line.split(' '))[1]),float((line.split(' '))[2]),float((line.split(' '))[3])))
    if line.find("f")==0:
        if line.split(' ').Count==4:
            mesh.Faces.AddFace(rg.MeshFace(int(line.split(' ')[1].split('/')[0])-1,int(line.split(' ')[2].split('/')[0])-1,int(line.split(' ')[3].split('/')[0])-1))
        if line.split(' ').Count==5:
            mesh.Faces.AddFace(rg.MeshFace(int(line.split(' ')[1].split('/')[0])-1,int(line.split(' ')[2].split('/')[0])-1,int(line.split(' ')[3].split('/')[0])-1,int(line.split(' ')[4].split('/')[0])-1))
mesh.Normals.ComputeNormals()
mesh.Compact()

xform = rs.XformTranslation([0.0,0.0,height_trunk])

canopy_mesh = rs.TransformObject(mesh, xform)
# ---------- end import_canopy ----------
mesh_trunk_branches = Mesh(proctree_js_to_gh_python.geom_trunk)
mesh_canopy = Mesh(import_canopy.canopy_mesh)
preview_2 = CustomPreview(Geometry=mesh_trunk_branches, Material=ColourSwatch(SwatchColor=RGB(122, 58, 18)))
preview_3 = CustomPreview(Geometry=mesh_canopy, Material=ColourSwatch(SwatchColor=RGBA(64, 120, 0, 100)))
